# Grasshopper definition assignment1_clustered.gh (Grasshopper 1.0.7)

# ---- group: Input parameters
floor_to_floor_ground_level = Slider(6, range=0..100)
width_of_block = Slider(25, range=0..100)
ground_frontage_recess = Slider(4, range=0..10)
entrance_to_the_site = Slider(0.2, range=0..1)
minimum_plot_size_m2 = Panel("11000")
maximum_plot_size_m2 = Panel("19000")
side_offset = Slider(12, range=0..100)
curve = Curve(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)
front_and_back_offset = Slider(2, range=0..100)

# ----
block_1_generation = Block1Generation(
    relay=curve,
    B=minimum_plot_size_m2,
    B_2=maximum_plot_size_m2,
    number_2=front_and_back_offset,
    number_5=entrance_to_the_site,
    number=side_offset,
    x=width_of_block,
    number_7=ground_frontage_recess,
    number_8=floor_to_floor_ground_level)  # -> out, C_2, C_3, C, breps
panel = Panel(block_1_generation.out)
boundary_surfaces = BoundarySurfaces(Edges=block_1_generation.C_2)
curve_2 = Curve(block_1_generation.C_3)
curve_3 = Curve(block_1_generation.C)
brep = Brep(block_1_generation.breps)

# ==== cluster Block1Generation
relay = ClusterInput()
curve = Curve(relay)
B = ClusterInput()
B_2 = ClusterInput()

# ---- group: Checking if Parcel boundary meets the requirements
area = Area(Geometry=relay)  # -> Area, Centroid
larger = LargerThan(FirstNumber=area.Area, SecondNumber=B)  # -> LargerThan, OrEqualTo
smaller = SmallerThan(FirstNumber=area.Area, SecondNumber=B_2)  # -> SmallerThan, OrEqualTo
dispatch = Dispatch(List=area.Area, DispatchPattern=larger.LargerThan)  # -> ListA, ListB
dispatch_2 = Dispatch(List=area.Area, DispatchPattern=smaller.SmallerThan)  # -> ListA, ListB
xnor = GateXnor(A=dispatch.ListA, B=dispatch_2.ListA)
dispatch_3 = Dispatch(List=area.Area, DispatchPattern=xnor)  # -> ListA, ListB
round = Round(Number=dispatch_3.ListA)  # -> Nearest, Floor, Ceiling
c_script = CSharpScript(x=xnor, y=round.Nearest)  # -> out, A; inputs x: Boolean, y: Double
# ---------- c_script: C# ----------
    if(x)
    {
      Print("Great!Parcel boundary is within plot size requirements. The area of plot is:" + y + "m2");
    }
    else{
      Print("land parcel area is exceeding/under the size limit");
    }
# ---------- end c_script ----------

# ----
number = ClusterInput()
number_2 = ClusterInput()
number_3 = Number(number)
number_4 = Number(number_2)

# ---- group: Generation of Offset Curve
disc = Discontinuity(Curve=curve, Level=1)  # -> Points, Parameters
shatter = Shatter(Curve=curve, Parameters=disc.Parameters)
panel = Panel("""1
3""")
panel_2 = Panel("""0
2""")
item = ListItem(List=shatter, Index=panel, Wrap=True)
item_2 = ListItem(List=shatter, Index=panel_2, Wrap=True)
neg = Negative(Value=number_3)
neg_2 = Negative(Value=number_4)
offcrv = OffsetCurve(Curve=item, Plane=PlaneXY(0, 0, 0), Distance=neg, BothSides=0, Kinks=0, CapType=0)  # -> simplify(flatten(Offset))
offcrv_2 = OffsetCurve(Curve=item_2, Plane=PlaneXY(0, 0, 0), Distance=neg_2, BothSides=0, Kinks=0, CapType=0)  # -> simplify(flatten(Offset))
relay_2 = Relay([offcrv_2, offcrv])
mcx = MultipleCurves(Curves=relay_2)  # -> Points, IndexA, IndexB, ParamA, ParamB
crv_cp = CurveClosestPoint(Point=mcx.Points, Curve=graft(relay_2))  # -> Point, Parameter, Distance
expression = Expression(x=crv_cp.Distance, Expression="Round(x,2)")
equals = Equality(FirstNumber=expression, SecondNumber="0")  # -> Equality, Inequality
cull = CullPattern(List=mcx.Points, CullPattern=equals.Equality)
crv_cp_2 = CurveClosestPoint(Point=cull, Curve=graft(relay_2))  # -> Point, Parameter, Distance
shatter_2 = Shatter(Curve=graft(relay_2), Parameters=crv_cp_2.Parameter)
item_3 = ListItem(List=shatter_2, Index=1, Wrap=True)  # -> flatten(Item)
join = JoinCurves(Curves=item_3, Preserve=False)

# ----
out = ClusterOutput(c_script.out)
C = ClusterOutput(join)
number_5 = ClusterInput()
number_6 = Number(number_5)
x = ClusterInput()

# ---- group: Generation of inside boundary after building width
disc_2 = Discontinuity(Curve=join, Level=1)  # -> Points, Parameters
shatter_3 = Shatter(Curve=join, Parameters=disc_2.Parameters)
item_4 = ListItem(List=shatter_3, Index=[1, 3], Wrap=True)
item_5 = ListItem(List=shatter_3, Index=0, Wrap=True)
eval = EvaluateCurve(Curve=reparameterize(item_5), Parameter=number_6)  # -> Point, Tangent, Angle
neg_3 = Negative(Value=x)
offset = OffsetCurve(Curve=join, Distance=neg_3, Corners=1)

# ----
C_2 = ClusterOutput(offset)

# ---- group: Generation of curves for the blocks
disc_3 = Discontinuity(Curve=offset, Level=1)  # -> Points, Parameters
shatter_4 = Shatter(Curve=offset, Parameters=disc_3.Parameters)
crv_cp_3 = CurveClosestPoint(Point=disc_3.Points, Curve=item_4)  # -> Point, Parameter, Distance
item_6 = ListItem(List=shatter_4, Index=0, Wrap=True)
end = EndPoints(Curve=item_6)  # -> Start, End
c_script_2 = CSharpScript(S=end.Start, E=end.End, t=number_6)  # -> out, A; inputs S: Point3d, E: Point3d, t: Double
# ---------- c_script_2: C# ----------
    if(t <= 0.5){
      A = E;
    }
    else{
      A = S;
    }
# ---------- end c_script_2 ----------
c_script_3 = CSharpScript(P=crv_cp_3.Point, t=number_6)  # -> out, A; inputs P: list of Point3d, t: Double
# ---------- c_script_3: C# ----------
    for(int i = 0;i < P.Count;i++){

      if(t <= 0.5){
        A = P[0];
      }
      else{
        A = P[1];
      }
    }
# ---------- end c_script_3 ----------
pt = Point(end.End)
ln = Line(StartPoint=c_script_2.A, EndPoint=c_script_3.A)

ln_2 = Line(StartPoint=disc_3.Points, EndPoint=eval.Point)
len = Length(Curve=ln_2)
sort = SortList(Keys=len)  # -> Keys, ValuesA
item_7 = ListItem(List=sort.Keys, Index=0, Wrap=True)
equals_2 = Equality(FirstNumber=len, SecondNumber=item_7)  # -> Equality, Inequality
dispatch_4 = Dispatch(List=ln_2, DispatchPattern=equals_2.Equality)  # -> ListA, ListB

crv_cp_4 = CurveClosestPoint(Point=eval.Point, Curve=item_5)  # -> Point, Parameter, Distance
shatter_5 = Shatter(Curve=item_5, Parameters=crv_cp_4.Parameter)
len_2 = Length(Curve=shatter_5)
sort_2 = SortList(Keys=len_2)  # -> Keys, ValuesA
item_8 = ListItem(List=sort_2.Keys, Index=0, Wrap=True)  # -> Item1, Item
equals_3 = Equality(FirstNumber=shatter_5, SecondNumber=item_8.Item1)  # -> Equality, Inequality
dispatch_5 = Dispatch(List=shatter_5, DispatchPattern=equals_3.Equality)  # -> ListA, ListB

item_9 = ListItem(List=crv_cp_3.Point, Index=0, Wrap=True)
c_script_4 = CSharpScript(P=crv_cp_3.Point, t=number_6)  # -> out, A; inputs P: list of Point3d, t: Double; same code as c_script_3
c_script_5 = CSharpScript(P=disc_2.Points, t=number_6)  # -> out, A; inputs P: list of Point3d, t: Double
# ---------- c_script_5: C# ----------
    for(int i = 0;i < P.Count;i++){

      if(t <= 0.5){
        A = P[1];
      }
      else{
        A = P[0];
      }
    }
# ---------- end c_script_5 ----------
ln_3 = Line(StartPoint=c_script_4.A, EndPoint=c_script_5.A)

# ----
number_7 = ClusterInput()

# ---- group: First Block
crv = Curve(ln_3)
crv_2 = Curve(item_6)
crv_3 = Curve(ln)
crv_4 = Curve(dispatch_5.ListA)
crv_5 = Curve(dispatch_4.ListA)
join_2 = JoinCurves(Curves=[crv_5, crv_2, crv_3, crv, crv_4], Preserve=False)

# ----
C_3 = ClusterOutput(join_2)
number_8 = ClusterInput()

number_9 = Number(number_7)
c_script_6 = CSharpScript(x=crv, y=number_9)  # -> out, A; inputs x: Curve, y: Double
# ---------- c_script_6: C# ----------
    double dist = x.GetLength();

    double distN = dist - y;



    A = distN/dist;
# ---------- end c_script_6 ----------
eval_2 = EvaluateCurve(Curve=crv_5, Parameter=c_script_6.A)  # -> Point, Tangent, Angle
eval_3 = EvaluateCurve(Curve=crv, Parameter=c_script_6.A)  # -> Point, Tangent, Angle
shatter_6 = Shatter(Curve=crv, Parameters=c_script_6.A)
shatter_7 = Shatter(Curve=crv_5, Parameters=c_script_6.A)
item_10 = ListItem(List=shatter_7, Index=0, Wrap=True)
item_11 = ListItem(List=shatter_6, Index=0, Wrap=True)
ln_4 = Line(StartPoint=eval_2.Point, EndPoint=eval_3.Point)
join_3 = JoinCurves(Curves=flatten([item_10, crv_2, crv_3, item_11, ln_4]), Preserve=False)
number_10 = Number(number_8)
Z = UnitZ(Factor=number_10)
extr = Extrude(Base=join_3, Direction=Z)
move = Move(Geometry=join_2, Motion=Z)  # -> Geometry, Transform
extr_2 = Extrude(Base=move.Geometry, Direction=Z)
cap_holes = CapHoles(Brep=extr_2)
cap_holes_2 = CapHoles(Brep=extr)
brep_join = BrepJoin(Breps=[cap_holes, cap_holes_2])  # -> Breps, Closed

breps = ClusterOutput(brep_join.Breps)
