# Grasshopper definition assignment2.gh (Grasshopper 1.0.7)
# plug-ins: LunchBox

number_slider = Slider(5, range=0..10)
number_slider_2 = Slider(5, range=0..10)
number_slider_3 = Slider(0.26, range=0..1)
surface = Surface(<surface referenced from the Rhino model>)
curve = Curve(<curve referenced from the Rhino model>)
curve_2 = Curve(<curve referenced from the Rhino model>)
surface_2 = Surface(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)
surface_3 = Surface(<surface referenced from the Rhino model>)
c_script = CSharpScript(x=curve, y=curve_2)  # -> out, A; inputs x: Curve, y: Curve
# ---------- c_script: C# ----------
    Brep[] sweep = Brep.CreateFromSweep(x, y, false, 0.001);
    A = sweep;
# ---------- end c_script ----------
c_script_2 = CSharpScript(S=surface_3)  # -> out, P, N, uv; inputs S: Surface, u: Int32
# ---------- c_script_2: C# ----------
    Surface x = S;

    Interval uDomain = x.Domain(0);
    Interval vDomain = x.Domain(1);
    Print(uDomain.ToString());

    x.SetDomain(0, new Interval(0, 1));
    x.SetDomain(1, new Interval(0, 1));
# ---------- end c_script_2 ----------
c_script_3 = CSharpScript(
    S=surface,
    NX=Slider(5, range=0..10),
    DX=Slider(2.27, range=0..10),
    NY=Slider(3, range=0..10),
    DY=Slider(1.81, range=0..10))  # -> A; inputs S: Surface, NX: Double, DX: Double, NY: Double
# ---------- c_script_3: C# ----------
    DataTree<Point3d> pts = new DataTree<Point3d>();
    
    for(int j = 0;j < NY;j++)
    {
      double y
    }
# ---------- end c_script_3 ----------
hexagon_cells = HexagonCells(Surface=surface_2, UDivisions=number_slider, VDivisions=number_slider_2, TParameter=number_slider_3)  # -> HexagonCells, Centers
c_script_4 = CSharpScript(
    surface=surface_2,
    u_Division=number_slider,
    v_Division=number_slider_2,
    t=number_slider_3,
    TooltipDescriptionOverride="LunchBox Hex Cells")  # -> out, P, Hex_cells; inputs surface: Surface, u_Division: Int32, v_Division: Int32, t: Double
# ---------- c_script_4: C# ----------
    ///////Sujal K S _ Updated on 12th Nov
    Component.Message = "LunchBox Hexagon panel";


    Surface x = surface;


    int Un = u_Division;
    int Vn = v_Division;

    Interval uDomain = x.Domain(0);
    Interval vDomain = x.Domain(1);


    double uStep = uDomain.Length / Un;
    double vStep = vDomain.Length / Vn;

    Print(uStep.ToString());
    Print(vStep.ToString());
    List<Point3d> uvPoints = new List<Point3d>();
    List<Vector3d> normals = new List<Vector3d>();
    List<Point3d> pts = new List<Point3d>();

    List<Point3d> evenPts = new List<Point3d>();
    List<Point3d> oddPts = new List<Point3d>();

    List<Point3d> centerPts = new List<Point3d>();



    List<Line> Lines = new List<Line>();

    List<Curve> curveListL = new List<Curve>();

    Curve[] curveList = new Curve[5];


    //UV points
    for(int i = 0;i < Un + 1;i++)
    {

      double u = uDomain.T0 + i * uStep;
      for(int j = 0;j < Vn + 1;j++)
      {

        double v = vDomain.T0 + j * vStep;


        Point3d pt = x.PointAt(u, v);
        pts.Add(pt);


        Vector3d normal = x.NormalAt(u, v);
        normals.Add(normal);

        Point3d p = new Point3d(u, v, 0);
        uvPoints.Add(p);

      }
    }

    //Lines to create hexagons
    for(int j = 0;j < pts.Count - 1;j++)
    {

      Line l = new Line(pts[j], pts[j + 1]);
      Lines.Add(l);

    }

    //Removing extra Lines
    for(int i = 1;i <= Un;i++)
    {
      for(int j = 0;j < pts.Count - 1;j++)
      {

        if(j == (i * Vn))
        {
          Lines.Remove(Lines[j]);
        }
      }
    }

    //Point on curve to control hexagon shapes
    for(int i = 0;i < Lines.Count ;i++)
    {

      if(i % 2 != 0){
        Point3d pt0 = Lines[i].PointAt(t);
        oddPts.Add(pt0);
      }
      else{
        double t2 = 1 - t;
        Point3d pt0 = Lines[i].PointAt(t2);
        evenPts.Add(pt0);
      }
    }

    //Algorithm for First set of hexagons

    for(int i = 0;i < 10;i = i + 3)
    {
      List<NurbsCurve> nC = new List<NurbsCurve>();

      for(int j = 0;j < 10;j = j + 3)
      {
        Line l1 = new Line(evenPts[j], oddPts[j]);
        Line l2 = new Line(oddPts[j], evenPts[j + (Vn - 2)]);
        Line l3 = new Line(evenPts[j + (Vn - 2)], oddPts[j + Vn]);
        Line l4 = new Line(oddPts[j + Vn], evenPts[j + Vn]);
        Line l5 = new Line(evenPts[j + Vn], oddPts[j + (Vn - 3)]);
        Line l6 = new Line(oddPts[j + (Vn - 3)], evenPts[j]);

        NurbsCurve n = l1.ToNurbsCurve();
        NurbsCurve n2 = l2.ToNurbsCurve();
        NurbsCurve n3 = l3.ToNurbsCurve();
        NurbsCurve n4 = l4.ToNurbsCurve();
        NurbsCurve n5 = l5.ToNurbsCurve();
        NurbsCurve n6 = l6.ToNurbsCurve();


        nC.Add(n);
        nC.Add(n2);
        nC.Add(n3);
        nC.Add(n4);
        nC.Add(n5);
        nC.Add(n6);
      }

      curveList = Curve.JoinCurves(nC);
    }

    //Center Points generation
    for(int i = 0;i < pts.Count - 1;i++)
    {
      if(i == 0 || i % 2 != 0)
      {
        centerPts.Add(pts[i]);
      }

    }

    P = centerPts;
    Hex_cells = curveList;
# ---------- end c_script_4 ----------
curve_3 = Curve(c_script_4.Hex_cells)
point = Point(c_script_4.P)
curve_4 = Curve(hexagon_cells.HexagonCells)
point_2 = Point(hexagon_cells.Centers)
